# Requirement set Transmission_Requirements (R2026a)

## 1 [#3] Engine Operating Limits
The transmission controller shall prevent operation of the engine outside its allowable operating range.

### 1.1 [#4] Maximum Engine Speed
The transmission controller shall prevent engine speed from exceeding 7250 RPM.
Rationale: Higher engine speeds will cause the internal piston forces to excess material limitations.

### 1.2 [#16] Minimum Engine Speed
The transmission controller shall prevent engine speed from dropping below 800 RPM.

## 2 [#1] Gear Selection Safety
The transmission controller shall permit gear selection only when operating conditions are valid for the requested gear.

### 2.1 [#2] Park Engagement
The transmission controller shall permit engagement of PARK only when |vehSpd| < 0.1 m/s

### 2.2 [#12] Drive Engagement
The transmission controller shall permit engagement of DRIVE only when vehicle speed is greater than -0.5 m/s.
Rationale: Engaging a forward gear while the vehicle is rolling backward quickly would shock the driveline.

### 2.3 [#13] Reverse Engagement
The transmission controller shall permit engagement of REVERSE only when vehicle speed is less than 0.5 m/s.
Rationale: Engaging reverse while the vehicle is rolling forward would shock the driveline.

### 2.4 [#14] Park Actuator Apply
The transmission controller shall command the parking actuator closed within 100 ms of PARK being engaged.
Rationale: The vehicle must be held promptly once it is parked.

### 2.5 [#15] Park Actuator Release
The transmission controller shall command the parking actuator released within 100 ms of the driver selecting a range other than PARK.
Rationale: A locked parking pawl must not be dragged when driving off.

## 3 [#9] Driver Request Handling
The transmission controller shall process driver gear requests according to transmission operating constraints.

### 3.1 [#10] Park Request Protection
The transmission controller shall always command neutral when park is selected
Rationale: If the transmission is in any drive or reverse gears it will cause undue strain on the engine and torque converter.

## 4 [#11] Vehicle Performance
The vehicle shall accelerate from 0 to 60 mph in less than 12 seconds when wide-open-throttle is applied (100% throttle)
Rationale: If 0-60 acceleration time is greater than 12 seconds it will create unsafe situations on the road during merging and other high-acceleration manoeuvers.