test file "Transmission_Test_Suite"

suite "10-Speed Transmission Controller"

  case "ETRS 3" [baseline]
    model TransmissionSystem, mode Normal, start time 0, stop time 65
    assessment "ETRS 3.1": At any point of time, whenever DriveRangeSelector == Park & VehicleSpeed <= 0.1 is true then, with no delay, GearCommanded == 0 must be true
      GearCommanded: signal TransmissionControl/Transmission Controller, port 2
      DriveRangeSelector: signal TransmissionControl/Variant Source2, port 1
      VehicleSpeed: signal TransmissionControl/LongitudinalVehiclePlant, port 3
      Park: expression RangeSelected.Park

  case "ETRS 4" [simulation]
    model TransmissionSystem, mode Normal, start time 0, stop time 65, variant configuration Test
    input "ETRS_0-60Log.mat", mapped to DriverBrake, DriverThrottle, DriverGearSelection (active)
    assessment "ETRS 4": At any point of time, if VehSpd > 0.1 becomes true then, with a delay of at most 12, VehSpd > 60 must be true
      VehSpd: signal TransmissionControl/Signal Specification, port 1

  case "ETRS 1_1_MaximumEngineSpeed" [baseline]
    model TransmissionSystem, mode Normal, start time 0, stop time 65
    input "ETRS_in_r1_1_test1.mat", mapped to DriverBrake, DriverThrottle, DriverGearSelection (active)
    assessment "Maximum Engine Speed": At any point of time, EngineSpeed must be less than or equal to 7250
      EngineSpeed: signal TransmissionSystem/LongitudinalVehiclePlant, port 4

  case "ETRS 1_2_MinimumEngineSpeed" [baseline]
    model TransmissionSystem, mode Normal, start time 0, stop time 65
    input "ETRS_DriverLog.mat", mapped to DriverBrake, DriverThrottle, DriverGearSelection (active)
    assessment "Assessment1": At any point of time, EngineSpeed must be greater than or equal to 800
      EngineSpeed: signal TransmissionSystem/LongitudinalVehiclePlant, port 4

  case "ETRS_2_1_ParkEngagement" [baseline]
    model TransmissionSystem, mode Normal, start time 0, stop time 10, variant configuration Test
    input "ETRS_in_r2_1-6.mat", mapped to DriverBrake, DriverThrottle, DriverGearSelection (active)
    assessment "Assessment1": At any point of time, whenever abs(Speed) >= 0.1 is true then, with no delay, ParkBrake == false must be true
      Speed: signal TransmissionSystem/Transmission Controller|TransmissionController/Vehicle Speed, port 1
      ParkBrake: signal TransmissionSystem/Transmission Controller, port 3

  case "ETRS_2_2_Park Engagement Response" [baseline]
    model TransmissionSystem, mode Normal, start time 0, stop time 65, variant configuration Test
    input "ETRS_in_r2_1-6.mat", mapped to DriverBrake, DriverThrottle, DriverGearSelection (active)
    assessment "Assessment1": At any point of time, if (ParkSelected) & (abs(Speed) < 0.1) becomes true then, with a delay of at most 0.1, ParkBrake == true must be true
      Speed: signal TransmissionSystem/Transmission Controller|TransmissionController/Vehicle Speed, port 1
      ParkBrake: signal TransmissionSystem/Transmission Controller, port 3
      ParkSelected: signal TransmissionSystem/Transmission Controller|TransmissionController/RangeSelected.Park, port 1

  case "ETRS_2_3_Park Release Response" [baseline]
    model TransmissionSystem, mode Normal, start time 0, stop time 65, variant configuration Test
    input "ETRS_in_r2_1-6.mat", mapped to DriverBrake, DriverThrottle, DriverGearSelection (active)
    assessment "Assessment1": At any point of time, whenever ~ParkSelected is true then, with a delay of at most 0.1, ParkBrake == false must be true
      ParkBrake: signal TransmissionSystem/Transmission Controller, port 3
      ParkSelected: signal TransmissionSystem/Transmission Controller|TransmissionController/RangeSelected.Park, port 1

  case "ETRS_2_4 Drive Selection Safety" [baseline]
    model TransmissionSystem, mode Normal, start time 0, stop time 65, variant configuration Test
    input "ETRS_in_r2_1-6.mat", mapped to DriverBrake, DriverThrottle, DriverGearSelection (active)
    assessment "Assessment1": At any point of time, whenever GearCommand == 1 | GearCommand == 2 | GearCommand == 3 | GearCommand == 4 | GearCommand == 5 | GearCommand == 6 | GearCommand == 7 | GearCommand == 8 | GearCommand == 9 | GearCommand == 10 is true then, with no delay, Speed > -0.5 must be true
      Speed: signal TransmissionSystem/Transmission Controller|TransmissionController/Vehicle Speed, port 1
      GearCommand: signal TransmissionSystem/Transmission Controller, port 2

  case "ETRS_2_5 Reverse Selection Safety" [baseline]
    model TransmissionSystem, mode Normal, start time 0, stop time 10, variant configuration Test
    input "ETRS_in_r2_1-6.mat", mapped to DriverBrake, DriverThrottle, DriverGearSelection (active)
    assessment "Assessment1": At any point of time, whenever GearCmd == -1 is true then, with no delay, Speed < 0.5 must be true
      Speed: signal TransmissionSystem/Transmission Controller|TransmissionController/Vehicle Speed, port 1
      GearCmd: signal TransmissionSystem/Transmission Controller, port 2

  case "ETRS_2_6 Neutral Availability" [baseline]
    model TransmissionSystem, mode Normal, start time 0, stop time 65, variant configuration Test
    input "ETRS_in_r2_1-6.mat", mapped to DriverBrake, DriverThrottle, DriverGearSelection (active)
    assessment "Assessment1" (off): At any point of time, whenever SelectNeutral is true then, with no delay, GearCmd == 0 must be true
      SelectNeutral: signal TransmissionSystem/Transmission Controller|TransmissionController/Compare To Constant4, port 1
      GearCmd: signal TransmissionSystem/Transmission Controller, port 2

  case "ETRS 3_2_1 Valid Drive Request Response" [baseline]
    model TransmissionSystem, mode Normal, start time 0, stop time 65
    input "ETRS_DriverLog.mat", mapped to DriverBrake, DriverThrottle, DriverGearSelection (active)
    assessment "Assessment1": At any point of time, whenever SelectedNeutral is true then, with no delay, GearCmd == 0 must be true
      GearCmd: signal TransmissionSystem/Transmission Controller, port 2
      SelectedNeutral: signal TransmissionSystem/Transmission Controller|TransmissionController/Compare To Constant4, port 1

  case "ETRS 3_3_1 Valid Reverse Request Response" [baseline]
    model TransmissionSystem, mode Normal, start time 0, stop time 65
    input "ETRS_DriverLog.mat", mapped to DriverBrake, DriverThrottle, DriverGearSelection (active)
    assessment "Assessment1": At any point of time, whenever (SelectedReverse) & (Speed < 0.5) & (~HoldNeutral) is true then, with a delay of at most 0.001, GearCmd == -1 must be true
      SelectedReverse: signal TransmissionSystem/Transmission Controller|TransmissionController/Compare To Constant5, port 1
      Speed: signal TransmissionSystem/Transmission Controller|TransmissionController/Vehicle Speed, port 1
      HoldNeutral: signal TransmissionSystem/Transmission Controller|TransmissionController/Direction Change Protection, port 1
      GearCmd: signal TransmissionSystem/Transmission Controller, port 2

  case "ETRS 3_4_Neutral Request Response" [baseline]
    model TransmissionSystem, mode Normal, start time 0, stop time 65
    input "ETRS_DriverLog.mat", mapped to DriverBrake, DriverThrottle, DriverGearSelection (active)
    assessment "Assessment1": At any point of time, whenever SelectedNeutral is true then, with no delay, GearCmd == 0 must be true
      GearCmd: signal TransmissionSystem/Transmission Controller, port 2
      SelectedNeutral: signal TransmissionSystem/Transmission Controller|TransmissionController/Compare To Constant4, port 1

  case "ETRS_4_Vehicle Performance" [simulation]
    model TransmissionSystem, mode Normal, start time 0, stop time 65, variant configuration Test
    input "ETRS_0-60Log.mat", mapped to DriverBrake, DriverThrottle, DriverGearSelection (active)
    assessment "Assessment1": At any point of time, if DriveActive & Throttle >= 0.99 becomes true then, with a delay of at most 20, VehicleSpeed >= 60 must be true
      DriveActive: signal TransmissionSystem/Transmission Controller|TransmissionController/AND, port 1
      Throttle: signal TransmissionSystem/Transmission Controller|TransmissionController/DriverThrottle, port 1
      VehicleSpeed: signal TransmissionSystem/Signal Specification, port 1

  case "ETRS_7_1_ForwardGearLimit" [baseline]
    model TransmissionSystem, mode Normal, start time 0, stop time 65, variant configuration Test
    input "ETRS_in_r6_1_test1.mat", mapped to DriverBrake, DriverThrottle, DriverGearSelection (active)
    assessment "Assessment1": At any point of time, whenever DriveActive is true then, with no delay, GearCommand == 1 | GearCommand == 2 | GearCommand == 3 | GearCommand == 4 | GearCommand == 5 | GearCommand == 6 | GearCommand == 7 | GearCommand == 8 | GearCommand == 9 | GearCommand == 10 must be true
      GearCommand: signal TransmissionSystem/Transmission Controller, port 2
      DriveActive: signal TransmissionSystem/Transmission Controller|TransmissionController/AND, port 1

  case "ETRS_7_2_DriveOnlyForwardGears" [baseline]
    model TransmissionSystem, mode Normal, start time 0, stop time 65, variant configuration Test
    input "ETRS_in_r6_2_test1.mat", mapped to DriverBrake, DriverThrottle, DriverGearSelection (active)
    assessment "Assessment1": At any point of time, whenever ~DriveActive is true then, with no delay, GearCommand == 0 | GearCommand == -1 must be true
      DriveActive: signal TransmissionSystem/Transmission Controller|TransmissionController/AND, port 1
      GearCommand: signal TransmissionSystem/Transmission Controller, port 2

  case "ETRS_7_4_Direction Reversal Protection" [baseline]
    model TransmissionSystem, mode Normal, start time 0, stop time 65, variant configuration Test
    input "ETRS_in_r6_2_test1.mat", mapped to DriverBrake, DriverThrottle, DriverGearSelection (active)
    assessment "Assessment1": At any point of time, whenever Reversal & (abs(Speed) >= 0.1) is true then, with no delay, GearCmd == 0 must be true
      Reversal: signal TransmissionSystem/Transmission Controller|TransmissionController/OR1, port 1
      Speed: signal TransmissionSystem/Transmission Controller|TransmissionController/Vehicle Speed, port 1
      GearCmd: signal TransmissionSystem/Transmission Controller, port 2

  case "ETRS_7_5_Direction Reversal Neutral Dwell" [baseline]
    model TransmissionSystem, mode Normal, start time 0, stop time 65, variant configuration Test
    input "ETRS_in_r6_2_test1.mat", mapped to DriverBrake, DriverThrottle, DriverGearSelection (active)
    assessment "Assessment1": At any point of time, if Reversal & (abs(Speed) < 0.1) becomes true then, with no delay, GearCmd == 0 must stay true for at least 0.1
      Reversal: signal TransmissionSystem/Transmission Controller|TransmissionController/OR1, port 1
      Speed: signal TransmissionSystem/Transmission Controller|TransmissionController/Vehicle Speed, port 1
      GearCmd: signal TransmissionSystem/Transmission Controller, port 2